# Grasshopper definition remesh.gh (Grasshopper 1.0.8)
# plug-ins: Kangaroo2 Components

mjoin = MeshJoin(Meshes=[<geometry referenced from the Rhino model> x100])
triremesh = TriRemesh(Geometry=mjoin, Length=Slider(70, range=0..100), Iterations=25)  # -> Triangulation, Dual, Creases
mesh = Mesh(triremesh.Dual)
